# Grasshopper definition GHSCRIPT.gh (Grasshopper 1.0.7)
# plug-ins: jSwan, EleFront, Human

panel = Panel("{\"header\":{\"name\":\"PDP-2023\",\"password\":\"KxeCZD56L6\"},\"body\":{\"req\":\"forward\",\"param\":{\"query\":\"PREFIX ioc: <http://w3id.org/ioc#> SELECT  ?element ?Geo WHERE {   ?element ioc:hasObjGeometry ?Geo.   }\"}}}")
panel_2 = Panel("{\"header\":{\"name\":\"PDP-2023\",\"password\":\"KxeCZD56L6\"},\"body\":{\"req\":\"forward\",\"param\":{\"query\":\"PREFIX ioc: <http://w3id.org/ioc#>PREFIX prov:   <http://www.w3.org/ns/prov#>SELECT  ?Element ?process ?ready ?finished ?started ?cancelled  WHERE{?process ioc:hasInputElement ?Element.?process ioc:hasProcessStatus ?status.        ?status prov:generatedAtTime ?statusTIME.        FILTER NOT EXISTS {            ?process ioc:hasProcessStatus ?status2.            ?status2 prov:generatedAtTime ?status2TIME.            FILTER (?statusTIME < ?status2TIME)             }                    ?status ioc:isFinished ?finished.        ?status ioc:isStarted ?started.        ?status ioc:isReady ?ready.        ?status ioc:isCancelled ?cancelled.  }\"}}}")
# 1. Login once
connection = Connection(user="PDP-2023", password="KxeCZD56L6", database="PDP_TS_01")  # -> connection_request_2, user_data_2

websocket_client_start = WebsocketClientStart(Address="wss://server.ip.rwth-aachen.de:443/ioc/ws", InitalMessage=connection.connection_request_2, Reset=Button())

# ----
# 2. choose query
list = ValueList({"getGeo": 0, "getStatus": 1}, selected="getStatus")
filter = StreamFilter(Gate=list, Stream0=panel, Stream1=panel_2)
dam = DataDam(DataA=filter, BufferDelay=10000000, BufferMode=0)
panel_3 = Panel(filter)
websocket_client_sender = WebsocketClientSender(WebsocketObjects=websocket_client_start, Message=dam)
trigger = Trigger(Interval=50, TimerInterval=50, Target=[websocket_client_sender, websocket_client_receiver])
# 3.manual update or timer
button = Button()
data = Data()
request = Data()
user_data = Data()
button_2 = Button()
selobj = ObjectsBySelection(Reset=Toggle(True), LiveMode=False)
getua = GetUserAttributes(Geometry=selobj)  # -> Keys, Values, BakeName
python = GhPythonScript(x=getua.Values, y="lamparter-stahltraeger-geschweisst")  # -> flatten(a); inputs x: list
# ---------- python: Python ----------
from ghpythonlib.componentbase import executingcomponent as component
import Grasshopper, GhPython
import System
import Rhino
import rhinoscriptsyntax as rs

class MyComponent(component):
    
    def RunScript(self, x, y):
        """Provides a scripting component.
            Inputs:
                x: The x script variable
                y: The y script variable
            Output:
                a: The a output variable"""
        
        __author__ = "Coworker"
        __version__ = "2022.02.24"
        
        import rhinoscriptsyntax as rs
        a = []
        for i in x:
            line = "<"+i+"> ioc:hasBLE " +"\""+y+"\""+"."
            a.append(line)
        # return outputs if you have them; here I try it for you:
        return a
# ---------- end python ----------
rhatt = GetRhinoAttributes()  # -> Name, Layer, Color
panel_4 = Panel(python)
# http://w3id.org/ioc#Process_Pfette_08_Einheben
# http://w3id.org/ioc#Process_Pfette_08_fixieren
# http://w3id.org/ioc#Process_Pfette_08_Endmontage
# http://w3id.org/ioc#Process_Pfette_09_Einheben
# http://w3id.org/ioc#Process_Pfette_09_fixieren
# http://w3id.org/ioc#Process_Pfette_09_Endmontage
# http://w3id.org/ioc#Process_Pfette_10_Einheben
# http://w3id.org/ioc#Process_Pfette_10_fixieren
# http://w3id.org/ioc#Process_Pfette_10_Endmontage
# http://w3id.org/ioc#Process_Pfette_11_Einheben
# http://w3id.org/ioc#Process_Pfette_11_fixieren
# http://w3id.org/ioc#Process_Pfette_11_Endmontage
# http://w3id.org/ioc#Process_Pfette_12_Einheben
# http://w3id.org/ioc#Process_Pfette_12_fixieren
# http://w3id.org/ioc#Process_Pfette_12_Endmontage
# http://w3id.org/ioc#Process_Pfette_13_Einheben
# http://w3id.org/ioc#Process_Pfette_13_fixieren
# http://w3id.org/ioc#Process_Pfette_13_Endmontage
# http://w3id.org/ioc#Process_Pfette_14_Einheben
# http://w3id.org/ioc#Process_Pfette_14_fixieren
# http://w3id.org/ioc#Process_Pfette_14_Endmontage
# http://w3id.org/ioc#Process_STB_U1_SchalungTransportieren
# http://w3id.org/ioc#Process_STB_U1_SchalungFertigen
# http://w3id.org/ioc#Process_STB_U2_SchalungTransportieren
# http://w3id.org/ioc#Process_STB_U2_SchalungFertigen
# http://w3id.org/ioc#Process_Stahlbinder_Transport_H1
# http://w3id.org/ioc#Process_Fertigung_Grossrobotik
# http://w3id.org/ioc#Process_Stahlbinder_Transport_H11
# http://w3id.org/ioc#Process_Stahlbinder_HUB_H1
# http://w3id.org/ioc#Process_Stahlbinder_Verbinden
# http://w3id.org/ioc#Process_Stahlbinder_Transport_H2
# http://w3id.org/ioc#Process_Stahlbinder_HUB_H2
# http://w3id.org/ioc#Process_Fertigung_WZL
# http://w3id.org/ioc#Process_Stahlbinder_Transport_H22
# http://w3id.org/ioc#Process_Holzbinder_Herstellung
# http://w3id.org/ioc#Process_Holzbinder_Transport
# http://w3id.org/ioc#Process_Holzbinder_Entladen_O1
# http://w3id.org/ioc#Process_Holzbinder_Entladen_O2
# http://w3id.org/ioc#Process_Holzbinder_Entladen_U
# http://w3id.org/ioc#Process_Holzbinder_Vormontage
# http://w3id.org/ioc#Process_Druckrohr_Transport
# http://w3id.org/ioc#Process_Druckrohr_Lagern
# http://w3id.org/ioc#Process_Pfette_Transport
# http://w3id.org/ioc#Process_Pfette_Lagerung
# http://w3id.org/ioc#Process_Pfette_Auspacken
panel_5 = Panel("""http://w3id.org/ioc#Process_Sauberkeitsschicht
http://w3id.org/ioc#Process_FundamentA_EinSchalen
http://w3id.org/ioc#Process_FundamentA_Giessen
http://w3id.org/ioc#Process_FundamentA_AusSchalen
http://w3id.org/ioc#Process_FundamentB_EinSchalen
http://w3id.org/ioc#Process_FundamentB_Giessen
http://w3id.org/ioc#Process_FundamentB_AusSchalen
http://w3id.org/ioc#Process_STB_U1_EinSchalen
http://w3id.org/ioc#Process_STB_U1_Giessen
http://w3id.org/ioc#Process_STB_U1_AusSchalen
http://w3id.org/ioc#Process_STB_U2_EinSchalen
http://w3id.org/ioc#Process_STB_U2_Giessen
http://w3id.org/ioc#Process_STB_U2_AusSchalen
http://w3id.org/ioc#Process_Stahlbinder_HUB
http://w3id.org/ioc#Process_Stahlbinder_fixieren
http://w3id.org/ioc#Process_Stahlbinder_Endmontage
http://w3id.org/ioc#Process_Holzbinder_HUB
http://w3id.org/ioc#Process_Holzbinder_sichern
http://w3id.org/ioc#Process_Holzbinder_Endmontage
http://w3id.org/ioc#Process_Druckrohr_1_Einheben
http://w3id.org/ioc#Process_Druckrohr_1_fixieren
http://w3id.org/ioc#Process_Druckrohr_1_Endmontage
http://w3id.org/ioc#Process_Druckrohr_2_Einheben
http://w3id.org/ioc#Process_Druckrohr_2_fixieren
http://w3id.org/ioc#Process_Druckrohr_2_Endmontage
http://w3id.org/ioc#Process_Druckrohr_3_Einheben
http://w3id.org/ioc#Process_Druckrohr_3_fixieren
http://w3id.org/ioc#Process_Druckrohr_3_Endmontage
http://w3id.org/ioc#Process_Windverband_Einheben
http://w3id.org/ioc#Process_Windverband_fixieren
http://w3id.org/ioc#Process_Windverband_Endmontage
http://w3id.org/ioc#Process_Pfette_01_Einheben
http://w3id.org/ioc#Process_Pfette_01_fixieren
http://w3id.org/ioc#Process_Pfette_01_Endmontage
http://w3id.org/ioc#Process_Pfette_02_Einheben
http://w3id.org/ioc#Process_Pfette_02_fixieren
http://w3id.org/ioc#Process_Pfette_02_Endmontage
http://w3id.org/ioc#Process_Pfette_03_Einheben
http://w3id.org/ioc#Process_Pfette_03_fixieren
http://w3id.org/ioc#Process_Pfette_03_Endmontage
http://w3id.org/ioc#Process_Pfette_04_Einheben
http://w3id.org/ioc#Process_Pfette_04_fixieren
http://w3id.org/ioc#Process_Pfette_04_Endmontage
http://w3id.org/ioc#Process_Pfette_05_Einheben
http://w3id.org/ioc#Process_Pfette_05_fixieren
http://w3id.org/ioc#Process_Pfette_05_Endmontage
http://w3id.org/ioc#Process_Pfette_06_Einheben
http://w3id.org/ioc#Process_Pfette_06_fixieren
http://w3id.org/ioc#Process_Pfette_06_Endmontage
http://w3id.org/ioc#Process_Pfette_07_Einheben
http://w3id.org/ioc#Process_Pfette_07_fixieren
http://w3id.org/ioc#Process_Pfette_07_Endmontage
http://w3id.org/ioc#Process_Pfette_08_Einheben
http://w3id.org/ioc#Process_Pfette_08_fixieren
http://w3id.org/ioc#Process_Pfette_08_Endmontage
http://w3id.org/ioc#Process_Pfette_09_Einheben
http://w3id.org/ioc#Process_Pfette_09_fixieren
http://w3id.org/ioc#Process_Pfette_09_Endmontage
http://w3id.org/ioc#Process_Pfette_10_Einheben
http://w3id.org/ioc#Process_Pfette_10_fixieren
http://w3id.org/ioc#Process_Pfette_10_Endmontage
http://w3id.org/ioc#Process_Pfette_11_Einheben
http://w3id.org/ioc#Process_Pfette_11_fixieren
http://w3id.org/ioc#Process_Pfette_11_Endmontage
http://w3id.org/ioc#Process_Pfette_12_Einheben
http://w3id.org/ioc#Process_Pfette_12_fixieren
http://w3id.org/ioc#Process_Pfette_12_Endmontage
http://w3id.org/ioc#Process_Pfette_13_Einheben
http://w3id.org/ioc#Process_Pfette_13_fixieren
http://w3id.org/ioc#Process_Pfette_13_Endmontage
http://w3id.org/ioc#Process_Pfette_14_Einheben
http://w3id.org/ioc#Process_Pfette_14_fixieren
http://w3id.org/ioc#Process_Pfette_14_Endmontage
http://w3id.org/ioc#Process_STB_U1_SchalungTransportieren
http://w3id.org/ioc#Process_STB_U1_SchalungFertigen
http://w3id.org/ioc#Process_STB_U2_SchalungTransportieren
http://w3id.org/ioc#Process_STB_U2_SchalungFertigen
http://w3id.org/ioc#Process_Stahlbinder_Transport_H1
http://w3id.org/ioc#Process_Fertigung_Grossrobotik
http://w3id.org/ioc#Process_Stahlbinder_Transport_H11
http://w3id.org/ioc#Process_Stahlbinder_HUB_H1
http://w3id.org/ioc#Process_Stahlbinder_Verbinden
http://w3id.org/ioc#Process_Stahlbinder_Transport_H2
http://w3id.org/ioc#Process_Stahlbinder_HUB_H2
http://w3id.org/ioc#Process_Fertigung_WZL
http://w3id.org/ioc#Process_Stahlbinder_Transport_H22
http://w3id.org/ioc#Process_Holzbinder_Herstellung
http://w3id.org/ioc#Process_Holzbinder_Transport
http://w3id.org/ioc#Process_Holzbinder_Entladen_O1
http://w3id.org/ioc#Process_Holzbinder_Entladen_O2
http://w3id.org/ioc#Process_Holzbinder_Entladen_U
http://w3id.org/ioc#Process_Holzbinder_Vormontage
http://w3id.org/ioc#Process_Druckrohr_Transport
http://w3id.org/ioc#Process_Druckrohr_Lagern
http://w3id.org/ioc#Process_Pfette_Transport
http://w3id.org/ioc#Process_Pfette_Lagerung
http://w3id.org/ioc#Process_Pfette_Auspacken""")
geo = Geometry([<mesh referenced from the Rhino model> x186])
filteratt = FilterByUserAttributes(Attributes=geo, Key="ElementiD", Val=data)  # -> flatten(Geo), flatten(Key), flatten(Val)
# http://w3id.org/ioc#Process_FundamentA
# http://w3id.org/ioc#Process_STB_U1
# http://w3id.org/ioc#Process_FundamentB
# http://w3id.org/ioc#Process_STB_U2
# http://w3id.org/ioc#Process_Stahlbinder
# http://w3id.org/ioc#Process_Holzbinder
# http://w3id.org/ioc#Process_Druckrohr_1
# http://w3id.org/ioc#Process_Druckrohr_2
# http://w3id.org/ioc#Process_Druckrohr_3
# http://w3id.org/ioc#Process_Windverband
# http://w3id.org/ioc#Process_Pfette_01
# http://w3id.org/ioc#Process_Pfette_02
# http://w3id.org/ioc#Process_Pfette_03
# http://w3id.org/ioc#Process_Pfette_04
# http://w3id.org/ioc#Process_Pfette_05
# http://w3id.org/ioc#Process_Pfette_06
# http://w3id.org/ioc#Process_Pfette_07
# http://w3id.org/ioc#Process_Pfette_08
# http://w3id.org/ioc#Process_Pfette_09
# http://w3id.org/ioc#Process_Pfette_10
# http://w3id.org/ioc#Process_Pfette_11
# http://w3id.org/ioc#Process_Pfette_12
# http://w3id.org/ioc#Process_Pfette_14
# http://w3id.org/ioc#Process_Pfette_13
data_2 = Data(filteratt.Geo)
panel_6 = Panel("""http://w3id.org/ioc#Process_Stahlbinder_Transport_H1
http://w3id.org/ioc#Process_Fertigung_Grossrobotik
http://w3id.org/ioc#Process_Stahlbinder_Transport_H11
http://w3id.org/ioc#Process_Stahlbinder_HUB_H1
http://w3id.org/ioc#Process_Stahlbinder_Verbinden
http://w3id.org/ioc#Process_Stahlbinder_Transport_H2
http://w3id.org/ioc#Process_Fertigung_WZL
http://w3id.org/ioc#Process_Stahlbinder_Transport_H22
http://w3id.org/ioc#Process_Stahlbinder_HUB_H2
http://w3id.org/ioc#Process_Holzbinder_Herstellung
http://w3id.org/ioc#Process_Holzbinder_Transport
http://w3id.org/ioc#Process_Holzbinder_Entladen_O1
http://w3id.org/ioc#Process_Holzbinder_Entladen_O2
http://w3id.org/ioc#Process_Holzbinder_Entladen_U
http://w3id.org/ioc#Process_Holzbinder_Vormontage
http://w3id.org/ioc#Process_Druckrohr_Transport
http://w3id.org/ioc#Process_Druckrohr_Lagern
http://w3id.org/ioc#Process_Pfette_Transport
http://w3id.org/ioc#Process_Pfette_Lagerung
http://w3id.org/ioc#Process_Pfette_Auspacken""")
geo_2 = Geometry()
selobj_2 = ObjectsBySelection(Reset=Toggle(True), LiveMode=False)
list_2 = ItemSelector(
    panel_6,
    {"", "http://w3id.org/ioc#Process_Stahlbinder_Transport_H1", "http://w3id.org/ioc#Process_Fertigung_Grossrobotik", "http://w3id.org/ioc#Process_Stahlbinder_Transport_H11", "http://w3id.org/ioc#Process_Stahlbinder_HUB_H1", "http://w3id.org/ioc#Process_Stahlbinder_Verbinden", "http://w3id.org/ioc#Process_Stahlbinder_Transport_H2", "http://w3id.org/ioc#Process_Fertigung_WZL", "http://w3id.org/ioc#Process_Stahlbinder_Transport_H22", "http://w3id.org/ioc#Process_Stahlbinder_HUB_H2", "http://w3id.org/ioc#Process_Holzbinder_Herstellung", "http://w3id.org/ioc#Process_Holzbinder_Transport", "http://w3id.org/ioc#Process_Holzbinder_Entladen_O1", "http://w3id.org/ioc#Process_Holzbinder_Entladen_O2", "http://w3id.org/ioc#Process_Holzbinder_Entladen_U", "http://w3id.org/ioc#Process_Holzbinder_Vormontage", "http://w3id.org/ioc#Process_Druckrohr_Transport", "http://w3id.org/ioc#Process_Druckrohr_Lagern", "http://w3id.org/ioc#Process_Pfette_Transport", "http://w3id.org/ioc#Process_Pfette_Lagerung", "http://w3id.org/ioc#Process_Pfette_Auspacken"}, selected="http://w3id.org/ioc#Process_Holzbinder_Herstellung")
selobj_3 = ObjectsBySelection(Reset=Toggle(True), LiveMode=False)
panel_7 = Panel("""http://w3id.org/ioc#Process_FundamentA
http://w3id.org/ioc#Process_Sauberkeitsschicht
http://w3id.org/ioc#Process_STB_U1
http://w3id.org/ioc#Process_FundamentA_EinSchalen
http://w3id.org/ioc#Process_FundamentA_Giessen
http://w3id.org/ioc#Process_FundamentA_AusSchalen
http://w3id.org/ioc#Process_FundamentB
http://w3id.org/ioc#Process_STB_U2
http://w3id.org/ioc#Process_FundamentB_EinSchalen
http://w3id.org/ioc#Process_FundamentB_Giessen
http://w3id.org/ioc#Process_FundamentB_AusSchalen
http://w3id.org/ioc#Process_Stahlbinder
http://w3id.org/ioc#Process_STB_U1_EinSchalen
http://w3id.org/ioc#Process_STB_U1_Giessen
http://w3id.org/ioc#Process_STB_U1_AusSchalen
http://w3id.org/ioc#Process_STB_U2_EinSchalen
http://w3id.org/ioc#Process_STB_U2_Giessen
http://w3id.org/ioc#Process_STB_U2_AusSchalen
http://w3id.org/ioc#Process_Holzbinder
http://w3id.org/ioc#Process_Stahlbinder_HUB
http://w3id.org/ioc#Process_Stahlbinder_fixieren
http://w3id.org/ioc#Process_Stahlbinder_Endmontage
http://w3id.org/ioc#Process_Druckrohr_1
http://w3id.org/ioc#Process_Druckrohr_2
http://w3id.org/ioc#Process_Druckrohr_3
http://w3id.org/ioc#Process_Holzbinder_HUB
http://w3id.org/ioc#Process_Holzbinder_sichern
http://w3id.org/ioc#Process_Holzbinder_Endmontage
http://w3id.org/ioc#Process_Windverband
http://w3id.org/ioc#Process_Druckrohr_1_Einheben
http://w3id.org/ioc#Process_Druckrohr_1_fixieren
http://w3id.org/ioc#Process_Druckrohr_1_Endmontage
http://w3id.org/ioc#Process_Druckrohr_2_Einheben
http://w3id.org/ioc#Process_Druckrohr_2_fixieren
http://w3id.org/ioc#Process_Druckrohr_2_Endmontage
http://w3id.org/ioc#Process_Druckrohr_3_Einheben
http://w3id.org/ioc#Process_Druckrohr_3_fixieren
http://w3id.org/ioc#Process_Druckrohr_3_Endmontage
http://w3id.org/ioc#Process_Pfette_01
http://w3id.org/ioc#Process_Windverband_Einheben
http://w3id.org/ioc#Process_Windverband_fixieren
http://w3id.org/ioc#Process_Windverband_Endmontage
http://w3id.org/ioc#Process_Pfette_02
http://w3id.org/ioc#Process_Pfette_01_Einheben
http://w3id.org/ioc#Process_Pfette_01_fixieren
http://w3id.org/ioc#Process_Pfette_01_Endmontage
http://w3id.org/ioc#Process_Pfette_03
http://w3id.org/ioc#Process_Pfette_02_Einheben
http://w3id.org/ioc#Process_Pfette_02_fixieren
http://w3id.org/ioc#Process_Pfette_02_Endmontage
http://w3id.org/ioc#Process_Pfette_04
http://w3id.org/ioc#Process_Pfette_03_Einheben
http://w3id.org/ioc#Process_Pfette_03_fixieren
http://w3id.org/ioc#Process_Pfette_03_Endmontage
http://w3id.org/ioc#Process_Pfette_05
http://w3id.org/ioc#Process_Pfette_04_Einheben
http://w3id.org/ioc#Process_Pfette_04_fixieren
http://w3id.org/ioc#Process_Pfette_04_Endmontage
http://w3id.org/ioc#Process_Pfette_06
http://w3id.org/ioc#Process_Pfette_05_Einheben
http://w3id.org/ioc#Process_Pfette_05_fixieren
http://w3id.org/ioc#Process_Pfette_05_Endmontage
http://w3id.org/ioc#Process_Pfette_07
http://w3id.org/ioc#Process_Pfette_06_Einheben
http://w3id.org/ioc#Process_Pfette_06_fixieren
http://w3id.org/ioc#Process_Pfette_06_Endmontage
http://w3id.org/ioc#Process_Pfette_08
http://w3id.org/ioc#Process_Pfette_07_Einheben
http://w3id.org/ioc#Process_Pfette_07_fixieren
http://w3id.org/ioc#Process_Pfette_07_Endmontage
http://w3id.org/ioc#Process_Pfette_09
http://w3id.org/ioc#Process_Pfette_08_Einheben
http://w3id.org/ioc#Process_Pfette_08_fixieren
http://w3id.org/ioc#Process_Pfette_08_Endmontage
http://w3id.org/ioc#Process_Pfette_10
http://w3id.org/ioc#Process_Pfette_09_Einheben
http://w3id.org/ioc#Process_Pfette_09_fixieren
http://w3id.org/ioc#Process_Pfette_09_Endmontage
http://w3id.org/ioc#Process_Pfette_11
http://w3id.org/ioc#Process_Pfette_10_Einheben
http://w3id.org/ioc#Process_Pfette_10_fixieren
http://w3id.org/ioc#Process_Pfette_10_Endmontage
http://w3id.org/ioc#Process_Pfette_12
http://w3id.org/ioc#Process_Pfette_11_Einheben
http://w3id.org/ioc#Process_Pfette_11_fixieren
http://w3id.org/ioc#Process_Pfette_11_Endmontage
http://w3id.org/ioc#Process_Pfette_13
http://w3id.org/ioc#Process_Pfette_12_Einheben
http://w3id.org/ioc#Process_Pfette_12_fixieren
http://w3id.org/ioc#Process_Pfette_12_Endmontage
http://w3id.org/ioc#Process_Pfette_14
http://w3id.org/ioc#Process_Pfette_13_Einheben
http://w3id.org/ioc#Process_Pfette_13_fixieren
http://w3id.org/ioc#Process_Pfette_13_Endmontage
http://w3id.org/ioc#Process_Pfette_16
http://w3id.org/ioc#Process_Pfette_14_Einheben
http://w3id.org/ioc#Process_Pfette_14_fixieren
http://w3id.org/ioc#Process_Pfette_14_Endmontage
http://w3id.org/ioc#Process_Pfette_15
http://w3id.org/ioc#Process_Pfette_16_Einheben
http://w3id.org/ioc#Process_Pfette_16_fixieren
http://w3id.org/ioc#Process_Pfette_16_Endmontage
http://w3id.org/ioc#Process_Pfette_15_Einheben
http://w3id.org/ioc#Process_Pfette_15_fixieren
http://w3id.org/ioc#Process_Pfette_15_Endmontage
http://w3id.org/ioc#Process_STB_U1_SchalungTransportieren
http://w3id.org/ioc#Process_STB_U1_SchalungFertigen
http://w3id.org/ioc#Process_STB_U2_SchalungTransportieren
http://w3id.org/ioc#Process_STB_U2_SchalungFertigen
http://w3id.org/ioc#Process_Stahlbinder_Transport_H1
http://w3id.org/ioc#Process_Fertigung_Grossrobotik
http://w3id.org/ioc#Process_Stahlbinder_Transport_H11
http://w3id.org/ioc#Process_Stahlbinder_HUB_H1
http://w3id.org/ioc#Process_Stahlbinder_Verbinden
http://w3id.org/ioc#Process_Stahlbinder_Transport_H2
http://w3id.org/ioc#Process_Fertigung_WZL
http://w3id.org/ioc#Process_Stahlbinder_Transport_H22
http://w3id.org/ioc#Process_Stahlbinder_HUB_H2
http://w3id.org/ioc#Process_Holzbinder_Herstellung
http://w3id.org/ioc#Process_Holzbinder_Transport
http://w3id.org/ioc#Process_Holzbinder_Entladen_O1
http://w3id.org/ioc#Process_Holzbinder_Entladen_O2
http://w3id.org/ioc#Process_Holzbinder_Entladen_U
http://w3id.org/ioc#Process_Holzbinder_Vormontage
http://w3id.org/ioc#Process_Druckrohr_Transport
http://w3id.org/ioc#Process_Druckrohr_Lagern
http://w3id.org/ioc#Process_Pfette_Transport
http://w3id.org/ioc#Process_Pfette_Lagerung
http://w3id.org/ioc#Process_Pfette_Auspacken""")
item = ListItem(Index=0, Wrap=True)
gate = StreamGate(Stream=selobj_2, Gate=Toggle(True))  # -> Target0, Target1
gate_2 = StreamGate(Stream=selobj_2, Gate=Toggle(False))  # -> Target0, Target1
getua_2 = GetUserAttributes(Geometry=selobj_3)  # -> Keys, Values, BakeName
panel_8 = Panel("https://rob.arch.rwth-aachen.de/ioc#Druckrohrgruppe3_1521-eed8-0aaf-007f56e00fe1")
panel_9 = Panel(list_2)

# ---- group: Input
getua_3 = GetUserAttributes(Geometry=gate_2.Target1)  # -> Keys, Values, BakeName
preview = CustomPreview(Geometry=gate_2.Target1, Material=ColourSwatch(SwatchColor=RGB(30, 255, 0)))

# ---- group: Output
getua_4 = GetUserAttributes(Geometry=gate.Target1)  # -> Keys, Values, BakeName
preview_2 = CustomPreview(Geometry=gate.Target1, Material=ColourSwatch(SwatchColor=RGB(255, 178, 0)))

# ----
panel_10 = Panel(getua_2.Values)
panel_11 = Panel(getua_4.Values)
prozesszuelement = GhPythonScript(x=getua_3.Values, x2=getua_4.Values, y=panel_9)  # -> flatten(a); inputs x: list, x2: list
# ---------- prozesszuelement: Python ----------
from ghpythonlib.componentbase import executingcomponent as component
import Grasshopper, GhPython
import System
import Rhino
import rhinoscriptsyntax as rs

class MyComponent(component):
    
    def RunScript(self, x,x2, y):
        """Provides a scripting component.
            Inputs:
                x: The x script variable
                y: The y script variable
            Output:
                a: The a output variable"""
        
        __author__ = "Coworker"
        __version__ = "2022.02.24"
        
        import rhinoscriptsyntax as rs
        a = []
        try:
            for i in x:
                line =  "<"+y+"> "+"ioc:hasInputElement"+" <"+i+">."
                #line = "<"+i+"> ioc:hasBLE " +"\""+y+"\""+"."
                a.append(line)
        except:
            pass
        try:
            for i in x2:
                line =  "<"+y+"> "+"ioc:hasOutputElement"+" <"+i+">."
                #line = "<"+i+"> ioc:hasBLE " +"\""+y+"\""+"."
                a.append(line)
        except:
             pass
        # return outputs if you have them; here I try it for you:
        return a
# ---------- end prozesszuelement ----------
panel_12 = Panel(prozesszuelement)
elementgruppen = GhPythonScript(x=panel_10, y=panel_8)  # -> flatten(a); inputs x: list
# ---------- elementgruppen: Python ----------
from ghpythonlib.componentbase import executingcomponent as component
import Grasshopper, GhPython
import System
import Rhino
import rhinoscriptsyntax as rs

class MyComponent(component):
    
    def RunScript(self, x, y):
        """Provides a scripting component.
            Inputs:
                x: The x script variable
                y: The y script variable
            Output:
                a: The a output variable"""
        
        __author__ = "Coworker"
        __version__ = "2022.02.24"
        
        import rhinoscriptsyntax as rs
        a = []
        try:
            for i in x:
                line =  "<"+y+"> "+"ioc:hasElement"+" <"+i+">."
                
                a.append(line)
        except:
            pass

        # return outputs if you have them; here I try it for you:
        return a
# ---------- end elementgruppen ----------
panel_13 = Panel(elementgruppen)
path = FilePath()
dejson = DeserializeJson(OutputsLocked=False)

websocket_client_receiver = WebsocketClientReceiver(WebsocketObjects=websocket_client_start, AutoUpdate=button)  # -> Message, Status

expression = Expression(x=websocket_client_receiver.Message, Expression="If(x = \" iocCore connection established.\", false, true)")
gate_3 = StreamGate(Stream=websocket_client_receiver.Message, Gate=expression)  # -> Target0, Target1
fragment = TextFragment(Text=gate_3.Target1, Start=0, Count=1000)
panel_14 = Panel(fragment)

rec = DataRecorder(gate_3.Target0, DataLimit=1, RecordData=True)

panel_15 = Panel(rec)

response = Data(gate_3.Target1)

# ---- group: This is for getting the geometry
dejson_2 = DeserializeJson(JSON=response, OutputsLocked=True)  # -> Head, Results
dejson_3 = DeserializeJson(JSON=dejson_2.Results, OutputsLocked=True)
dejson_4 = DeserializeJson(JSON=dejson_3, OutputsLocked=True)  # -> Geo, Element
dejson_5 = DeserializeJson(JSON=dejson_4.Element, OutputsLocked=True)  # -> Type, Value
dejson_6 = DeserializeJson(JSON=dejson_4.Geo, OutputsLocked=True)  # -> Type, Value
load_obj = PythonScript(B64Geo=dejson_6.Value)  # -> Geo
# ---------- load_obj: Python ----------
from ghpythonlib.componentbase import executingcomponent as component
import Grasshopper, GhPython
import System
import Rhino
import rhinoscriptsyntax as rs
import base64

class MyComponent(component):
    
    def RunScript(self, B64Geo):
        import Rhino.Geometry as rg
        basestring = str(B64Geo)
        _basestring = basestring.replace(":","=")
        print (basestring)
        print (type(basestring))
        test = base64.b64decode(_basestring)
        #line = base64.b64decode(basestring).decode('utf-8')
  
        
        mesh = rg.Mesh()
        for line in test.splitlines():
            print (line)
            if line.find("v")==0 and line.find("n")==-1 and line.find("t")==-1:
                #print line.split(' ')
                mesh.Vertices.Add(rg.Point3d(float((line.split(' '))[1]),float((line.split(' '))[2]),float((line.split(' '))[3])))
            if line.find("f")==0:
                if line.split(' ').Count==4:
                    mesh.Faces.AddFace(rg.MeshFace(int(line.split(' ')[1].split('/')[0])-1,int(line.split(' ')[2].split('/')[0])-1,int(line.split(' ')[3].split('/')[0])-1))
                if line.split(' ').Count==5:
                    mesh.Faces.AddFace(rg.MeshFace(int(line.split(' ')[1].split('/')[0])-1,int(line.split(' ')[2].split('/')[0])-1,int(line.split(' ')[3].split('/')[0])-1,int(line.split(' ')[4].split('/')[0])-1))
        mesh.Normals.ComputeNormals()
        mesh.Compact()
        Geo = mesh
        print (mesh)
     
        
        # return outputs if you have them; here I try it for you:
        return (Geo)
# ---------- end load_obj ----------
merge = Merge(Data1=graft(dejson_5.Value))
attributes = DefineObjectAttributes(UserKeys="ElementID", UserValues=merge)
bake = BakeObjects(Geometry=load_obj, Attributes=flatten(attributes), Bake=Button())

# ---- group: This is for status viz
dejson_7 = DeserializeJson(JSON=response, OutputsLocked=True)  # -> Head, Results
mesh = Mesh([<mesh referenced from the Rhino model> x4])
dejson_8 = DeserializeJson(JSON=dejson_7.Results, OutputsLocked=True)
getua_5 = GetUserAttributes(Geometry=mesh)  # -> Keys, flatten(Values), BakeName
panel_16 = Panel(getua_5.Values)
dejson_9 = DeserializeJson(JSON=dejson_8, OutputsLocked=True)  # -> Process, Ready, Element, Cancelled, Finished, Started
dejson_10 = DeserializeJson(JSON=dejson_9.Finished, OutputsLocked=True)  # -> Datatype, Type, Value
dejson_11 = DeserializeJson(JSON=dejson_9.Element, OutputsLocked=True)  # -> Type, Value
findguid = PythonScript(searchGUID=dejson_11.Value, Input=mesh, GUID=getua_5.Values)  # -> Geo; inputs searchGUID: list, Input: list, GUID: list
# ---------- findguid: Python ----------
from ghpythonlib.componentbase import executingcomponent as component
import Grasshopper, GhPython
import System
import Rhino
import rhinoscriptsyntax as rs

class MyComponent(component):
    
    def RunScript(self, searchGUID, Input, GUID):
        import Rhino.Geometry as rg
        GUIDsearch = searchGUID
        GUIDlist = GUID
        Outlist = []
        meshlist = Input
        
        for gui in GUIDsearch:
            k=GUIDlist.index(gui)
            Outlist.append(meshlist[k])
            



        
        Geo = Outlist
        # return outputs if you have them; here I try it for you:
        return (Geo)
# ---------- end findguid ----------
filter_2 = StreamFilter(
    Gate=dejson_10.Value,
    Stream0=ColourSwatch(SwatchColor=RGB(255, 0, 0)),
    Stream1=ColourSwatch(SwatchColor=RGB(0, 255, 136)))
preview_3 = CustomPreview(Geometry=findguid, Material=filter_2)

# ----
dejson_12 = DeserializeJson(JSON=dejson_9.Process, OutputsLocked=True)  # -> Type, Value
panel_17 = Panel(dejson_12.Value)

# ==== cluster Connection
password = ClusterInput()
database = ClusterInput()
user = ClusterInput()
password_2 = Data(password)
database_2 = Data(database)
user_2 = Data(user)
merge = Merge(Data1=database_2, Data2="https://server.ip.rwth-aachen.de/ioc/stardog")
merge_2 = Merge(Data1="name", Data2="password")
merge_3 = Merge(Data1=user_2, Data2=password_2)
merge_4 = Merge(Data1="database", Data2="endpoint")
rejsonkv = SerializeKeysAndValues(Key=merge_4, Value=merge)  # -> flatten(JSON)
rejsonkv_2 = SerializeKeysAndValues(Key=merge_2, Value=merge_3)  # -> flatten(JSON)
merge_5 = Merge(Data1=rejsonkv_2, Data2=rejsonkv)
merge_6 = Merge(Data1="header", Data2="body")
rejsonkv_3 = SerializeKeysAndValues(Key=merge_6, Value=merge_5)  # -> flatten(JSON)
connection_request = Data(rejsonkv_3)
user_data = Data(merge_3)
user_data_2 = ClusterOutput(user_data)
connection_request_2 = ClusterOutput(connection_request)
